# Grasshopper definition Curstom_C#_and_ghPython_user_objects_001.gh (Grasshopper 1.0.7)
# plug-ins: Bifocals

# ----
# Custom C# UserObjects for Brep(s)
booleanunion2breps = BooleanUnion2Breps()  # -> out, BooleanedBreps; inputs breps: list of Brep, tol: Double; disabled
# ---------- booleanunion2breps: C# usings ----------
using System.IO;
using System.Linq;
using System.Data;
using System.Drawing;
using System.Reflection;
using System.Windows.Forms;
using System.Xml;
using System.Xml.Linq;
using System.Runtime.InteropServices;

using Rhino.DocObjects;
using Rhino.Collections;
using GH_IO;
using GH_IO.Serialization;
# ---------- booleanunion2breps: C# ----------
    //Boolean union the input breps
    Brep[] unionBrep = Brep.CreateBooleanUnion(breps, tol);

    BooleanedBreps = unionBrep;
# ---------- end booleanunion2breps ----------
createbrepbox = CreateBrepBox()  # -> out, BrepBox; inputs corners: list of Point3d
# ---------- createbrepbox: C# ----------
    //Build the brep from corners
    Brep twistedBox = Brep.CreateFromBox(corners);

    BrepBox = twistedBox;
# ---------- end createbrepbox ----------
calculateareavolumecentroid = CalculateAreaVolumeCentroid()  # -> out, Area, Vol, Centroid; inputs brep: Brep
# ---------- calculateareavolumecentroid: C# ----------
    //Declare variable
    double volume = 0;
    double area = 0;
    Point3d vc = default(Point3d);

    //Create a new instance of the mass properties classes
    VolumeMassProperties volume_mass = VolumeMassProperties.Compute(brep);
    AreaMassProperties area_mass = AreaMassProperties.Compute(brep);

    //Calculate area, volume and centroid
    area = brep.GetArea();
    //or: area = area_mass.Area
    volume = brep.GetVolume();
    //or: volume = volume_mass.Volume
    vc = volume_mass.Centroid;


    //Print
    Print(string.Format("Area = {0:F2}", area));
    Print(string.Format("Volume = {0:F2}", volume));
    Print(string.Format("Volume centroid = ({0:F2},{1:F2},{2:F2})", vc.X, vc.Y, vc.Z));

    //Assign output
    Area = area;
    Vol = volume;
    Centroid = vc;
# ---------- end calculateareavolumecentroid ----------
countbreptopologyandextractgeometry = CountBrepTopologyAndExtractGeometry()  # -> out, Vertices, Curves, Surfaces; inputs brep: Brep
# ---------- countbreptopologyandextractgeometry: C# ----------
    //print the number of geometry elements
    Print("brep.Vertices.Count = {0}", brep.Vertices.Count);
    Print("brep.Curves3D.Count = {0}", brep.Curves3D.Count);
    //untrimmed curves of all edges
    Print("brep.Curves2D.Count = {0}", brep.Curves2D.Count);
    Print("brep.Surfaces.Count = {0}", brep.Surfaces.Count);
    //untrimed surface of all faces

    //print the number of topology elements
    Print("brep.Trims.Count = {0}", brep.Trims.Count);
    Print("brep.Loops.Count = {0}", brep.Loops.Count);
    Print("brep.Faces.Count = {0}", brep.Faces.Count);
    Print("brep.Edges.Count = {0}", brep.Edges.Count);

    //extract 3d geometry elements
    Vertices = brep.Vertices;
    Curves = brep.Curves3D;
    Surfaces = brep.Surfaces;
# ---------- end countbreptopologyandextractgeometry ----------

createsolidbrep = CreateSolidBrep()  # -> out, SolidBrep; inputs breps: list of Brep, tol: Double
# ---------- createsolidbrep: C# ----------
    //Build the brep from corners
    Brep[] solids = Brep.CreateSolid(breps, tol);

    //Assign output
    SolidBrep = solids;
# ---------- end createsolidbrep ----------

number_slider = Slider(3, range=0..10)

range = Range(Domain=Slider(7.8, range=0..10), Steps=number_slider)

unit_x = UnitX(Factor=range)
unit_z = UnitZ(Factor=range)
unit_y = UnitY(Factor=range)

geometry = Geometry([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])
move = Move(Geometry=graft(geometry), Motion=unit_x)  # -> Geometry, Transform

booleanunion2breps_2 = BooleanUnion2Breps(breps=move.Geometry, tol=Slider(0.001, range=0..0.001))  # -> out, BooleanedBreps; inputs breps: list of Brep, tol: Double; same code as booleanunion2breps
solid_union = SolidUnion(Breps=move.Geometry)

countbreptopologyandextractgeometry_2 = CountBrepTopologyAndExtractGeometry(brep=booleanunion2breps_2.BooleanedBreps)  # -> out, Vertices, Curves, Surfaces; inputs brep: Brep; same code as countbreptopologyandextractgeometry

volume = Volume()  # -> Volume, Centroid
area = Area()  # -> Area, Centroid
calculateareavolumecentroid_2 = CalculateAreaVolumeCentroid(brep=booleanunion2breps_2.BooleanedBreps)  # -> out, Area, Vol, Centroid; inputs brep: Brep; same code as calculateareavolumecentroid

point = Point(countbreptopologyandextractgeometry_2.Vertices)
curve = Curve(countbreptopologyandextractgeometry_2.Curves)
surface = Surface(countbreptopologyandextractgeometry_2.Surfaces)
param_viewer = ParamViewer(booleanunion2breps_2.BooleanedBreps)
panel = Panel(booleanunion2breps_2.BooleanedBreps)
gene_pool = GenePool(Decimals=0, Maximum=3, Minimum=0, Value=[3, 1, 0, 2])
gene_pool_2 = GenePool(Decimals=0, Maximum=3, Minimum=0, Value=[0, 3, 1, 2])
panel_2 = Panel(calculateareavolumecentroid_2.Area)
panel_3 = Panel(calculateareavolumecentroid_2.Vol)
panel_4 = Panel(calculateareavolumecentroid_2.Centroid)
dispatch = Dispatch(List=flatten(point), DispatchPattern=[True, False])  # -> ListA, ListB
point_2 = Point(calculateareavolumecentroid_2.Centroid)
addition = Addition(A=gene_pool_2, B=Slider(24, range=0..100))
panel_5 = Panel(calculateareavolumecentroid_2.out)
panel_6 = Panel(countbreptopologyandextractgeometry_2.out)
addition_2 = Addition(A=gene_pool, B=Slider(34, range=0..100))
polar_array = PolarArray(
    Geometry=booleanunion2breps_2.BooleanedBreps,
    Plane=calculateareavolumecentroid_2.Centroid,
    Count=number_slider,
    Angle=6.283185307)  # -> Geometry, Transform
surface_2 = Surface(flatten(surface))
list_item = ListItem(List=dispatch.ListA, Index=addition_2, Wrap=True)  # -> flatten(Item)
list_item_2 = ListItem(List=flatten(point_2), Index=0, Wrap=True)
move_2 = Move(Geometry=list_item, Motion=Vector(0, 0, 10))  # -> Geometry, Transform
param_viewer_2 = ParamViewer(polar_array.Geometry)
panel_7 = Panel(polar_array.Geometry)
list_item_3 = ListItem(List=dispatch.ListB, Index=addition, Wrap=True)  # -> flatten(Item)
list_length = ListLength(List=list_item_3)
subtraction = Subtraction(A=list_length, B=Slider(1, range=0..10))
createbrepbox_2 = CreateBrepBox(corners=[move_2.Geometry, list_item_3])  # -> out, BrepBox; inputs corners: list of Point3d; same code as createbrepbox
range_2 = Range(Domain=Slider(2, range=0..2), Steps=subtraction)
line = Line(StartPoint=list_item_2, EndPoint=move_2.Geometry)
box_corners = BoxCorners(Box=createbrepbox_2.BrepBox)  # -> CornerA, CornerB, CornerC, CornerD, CornerE, CornerF, CornerG, CornerH

rotate_3d = Rotate3D(Geometry=graft(curve), Angle=range_2, Center=list_item_2, Axis=line)  # -> Geometry, Transform
rotate_3d_2 = Rotate3D(Geometry=createbrepbox_2.BrepBox, Angle=range_2, Center=list_item_2, Axis=line)  # -> Geometry, Transform

panel_8 = Panel(rotate_3d_2.Geometry)
param_viewer_3 = ParamViewer(rotate_3d_2.Geometry)

findboundingboxandcenter = FindBoundingBoxAndCenter()  # -> out, BBox, BBoxCenter; inputs brep: Brep
# ---------- findboundingboxandcenter: C# ----------
    //Declare variables
    BoundingBox bbox = new BoundingBox();
    Point3d center = default(Point3d);

    //Find the boundingbox
    bbox = brep.GetBoundingBox(true);

    //Find the center of the bounding box
    center = bbox.Center;

    //Assign output
    BBox = bbox;
    BBoxCenter = center;
# ---------- end findboundingboxandcenter ----------
createbrepfromedges = CreateBrepFromEdges()  # -> out, EdgeBrep; inputs crvs: list of Curve
# ---------- createbrepfromedges: C# ----------
    //Build the brep from edges
    Brep brep = Brep.CreateEdgeSurface(crvs);

    //Assign output
    EdgeBrep = brep;
# ---------- end createbrepfromedges ----------
movefacesawayfromcenter = MoveFacesAwayFromCenter()  # -> out, A; inputs brep: Brep
# ---------- movefacesawayfromcenter: C# ----------
    //Declare a new ist of faces
    List<Brep> faces = new List<Brep>();

    //Find the center
    Point3d center = brep.GetBoundingBox(true).Center;

    //Check all the faces
    for (int i = 0; i <= brep.Faces.Count - 1; i++) {
      //extract the faces
      int[] i_list = { i };
      Brep face = brep.DuplicateSubBrep(i_list);

      //Find face center
      Point3d face_center = face.GetBoundingBox(true).Center;

      //Find moving direction
      Vector3d dir = new Vector3d();
      dir = face_center - center;

      //move the face
      face.Translate(dir);

      //Add to the list
      faces.Add(face);
    }

    //Assign output
    A = faces;
# ---------- end movefacesawayfromcenter ----------
findifbrepsolid_oneatatime = FindIfBrepSolidOneAtATime()  # -> out, A; inputs brep: Brep
# ---------- findifbrepsolid_oneatatime: C# ----------
    //Assign output
    if(brep.IsValid)
      A = brep.IsSolid;
# ---------- end findifbrepsolid_oneatatime ----------
navigatingtopologyofbrep = NavigatingTopologyOfBrep()  # -> out, Faces, FaceSurfaces, Loops2DCurves, Loops3DCurves, Edges, Trims2DCurves, Vertices; inputs brep: Brep
# ---------- navigatingtopologyofbrep: C# ----------
    Rhino.Geometry.Collections.BrepFaceList faces = brep.Faces;
    List<Rhino.Geometry.Surface> surfaces = new List<Rhino.Geometry.Surface>();
    for(int fi = 0; fi < faces.Count; fi++)
    {
      BrepFace face = faces[fi];
      //Get Adjacent faces
      var aFaces = face.AdjacentFaces();
      //Get Adjacent edges
      var aEdges = face.AdjacentEdges();
      //Get face loops
      var faceLoops = face.Loops;
      //Get the 3D untrimmed surface
      var face3dSurface = face.UnderlyingSurface();
      surfaces.Add(face3dSurface);
    }
    Faces = faces;
    FaceSurfaces = surfaces;

    //BrepLoop topology (2D parameter space)
    Rhino.Geometry.Collections.BrepLoopList loops = brep.Loops;
    List<Rhino.Geometry.Curve> loops2DCrvs = new List<Rhino.Geometry.Curve>();
    List<Rhino.Geometry.Curve> loops3DCrvs = new List<Rhino.Geometry.Curve>();
    for(int li = 0; li < loops.Count; li++)
    {
      BrepLoop loop = loops[li];
      //Get loop face
      var loopFace = loop.Face;
      //Get loop trims
      var loopTrims = loop.Trims;
      //Get loop 2D and 3D curves
      var loop2dCurve = loop.To2dCurve();
      var loop3dCurve = loop.To3dCurve();
      loops2DCrvs.Add(loop2dCurve);
      loops3DCrvs.Add(loop3dCurve);
    }
    Loops2DCurves = loops2DCrvs;
    Loops3DCurves = loops3DCrvs;

    //BrepEdge topology (3D modeling space)
    Rhino.Geometry.Collections.BrepEdgeList edges = brep.Edges;
    for(int ei = 0; ei < edges.Count; ei++)
    {
      BrepEdge edge = edges[ei];
      //Get edge faces
      var eFaces_i = edge.AdjacentFaces();
      //Get edge start and end vertices
      var eStartVertex = edge.StartVertex;
      var eEndVertex = edge.EndVertex;
      //Get edge trim indices
      var eTrimIndeces = edge.TrimIndices();
      //Get edge 3D curve
      var e3dCurve = edge.EdgeCurve;
    }
    Edges = edges;

    //BrepTrim topology (2D parameter space)
    Rhino.Geometry.Collections.BrepTrimList trims = brep.Trims;
    for(int ti = 0; ti < trims.Count; ti++)
    {
      BrepTrim trim = trims[ti];
      //Get the edge
      var trimEdge = trim.Edge;
      //Get trim start and end vertices
      var trimStartVertex = trim.StartVertex;
      var trimEndVertex = trim.EndVertex;
      //Get trim loop
      var trimLoop = trim.Loop;
      //Get trim face
      var trimFace = trim.Face;
      //Get trim 2D curve
      var trim2dCurve = trim.TrimCurve;
    }
    Trims2DCurves = trims;

    //BrepVertex topology (3D modeling space)
    Rhino.Geometry.Collections.BrepVertexList vertices = brep.Vertices;
    for(int vi = 0; vi < vertices.Count; vi++)
    {
      BrepVertex vertex = vertices[vi];
      //Get vertex edges
      var vEdges = vertex.EdgeIndices();
      //Get vertex location
      var vPoint = vertex.Location;
    }
    Vertices = vertices;
# ---------- end navigatingtopologyofbrep ----------
mergecoplanarfaces = MergeCoPlanarFaces()  # -> out, MergedBrep; inputs brep: Brep, tol: Double
# ---------- mergecoplanarfaces: C# ----------
    //merge all coplanar faces
    if( brep.MergeCoplanarFaces(tol) )
      MergedBrep = brep;
# ---------- end mergecoplanarfaces ----------
extractoutlineandignorholes = ExtractOutlineAndIgnorHoles()  # -> out, Outline; inputs brep: Brep
# ---------- extractoutlineandignorholes: C# ----------
    //declare outline list of curves
    List<Curve> outlineCrvs = new List<Curve>();

    //check all the loops

    foreach (BrepLoop e_loop in brep.Loops) {
      //Make sure the loop type is outer

      if (e_loop.LoopType == BrepLoopType.Outer) {
        //Navigate through the trims of the loop

        foreach (BrepTrim trim in e_loop.Trims) {
          //Get the edge of each trim
          BrepEdge edge = trim.Edge;

          //Check if the edge has only one trim

          if (edge.TrimCount == 1) {
            //Add a copy of the edge curve to the list
            outlineCrvs.Add(edge.DuplicateCurve());
          }
        }
      }
    }

    //Assign output
    Outline = outlineCrvs;
# ---------- end extractoutlineandignorholes ----------
findifbrepissolid_aslist = FindIfBrepIsSolidAsList()  # -> out, A; inputs breps: list of Brep
# ---------- findifbrepissolid_aslist: C# ----------
    List<bool> isSolid = new List<bool>();
    foreach( Brep brep in breps)
      if( brep.IsValid )
        isSolid.Add(brep.IsSolid);

    A = isSolid;
# ---------- end findifbrepissolid_aslist ----------

createsolidbrep_2 = CreateSolidBrep(breps=rotate_3d_2.Geometry, tol=Slider(0.001, range=0..0.011))  # -> out, SolidBrep; inputs breps: list of Brep, tol: Double; same code as createsolidbrep
